# Grasshopper definition text_embeddings.gh (Grasshopper 1.0.7)
# plug-ins: GH_CPython

gh_cpython = GH_CPython()  # -> x_coords, y_coords, z_coords, tokens
#   port tokens: indicate your output description here. refers to a new line.
# ---------- gh_cpython: Python ----------
# -*- coding: utf-8 -*-
""" 
Python Script
Created on  Friday October 2024 08:31:47 
@author:  willi 

"""

import csv

# Define the file path to the CSV
csv_file_path = r"G:\\My Drive\\token_latent_space.csv"

# Initialize lists to store X, Y, Z coordinates and tokens
x_coords = []
y_coords = []
z_coords = []
tokens = []

# Open and read the CSV file
with open(csv_file_path, newline='', encoding='utf-8') as csvfile:
    csv_reader = csv.reader(csvfile)
    
    # Skip the header row
    next(csv_reader)
    
    # Loop through the rows and extract X, Y, Z and token
    for row in csv_reader:
        x_coords.append(float(row[0]))  # X coordinate
        y_coords.append(float(row[1]))  # Y coordinate
        z_coords.append(float(row[2]))  # Z coordinate
        tokens.append(row[3])           # Token

# Output the extracted values
print("X coordinates:", x_coords)
print("Y coordinates:", y_coords)
print("Z coordinates:", z_coords)
print("Tokens:", tokens)

# You can further process these values in gh_cpython to visualize them or manipulate them as needed.
# ---------- end gh_cpython ----------
pt = ConstructPoint(XCoordinate=gh_cpython.x_coords, YCoordinate=gh_cpython.y_coords, ZCoordinate=gh_cpython.z_coords)
bnd = Bounds(Numbers=pt)
number_slider = Slider(0.162, range=0..1)
remap = RemapNumbers(Value=pt, Source=bnd, Target=Domain(0, 1))  # -> Mapped, Clipped
gradient = Gradient(LowerLimit=0, UpperLimit=1, Parameter=remap.Mapped, stops=[0: RGB(0, 128, 0), 0.5: RGB(255, 255, 0), 1: RGB(255, 0, 0)])
tag = TextTag3D(Location=pt, Text=gh_cpython.tokens, Size=number_slider, Colour=gradient, Justification=7)
pt_2 = ConstructPoint(XCoordinate=Slider(3, range=-5..5), YCoordinate=Slider(1, range=-5..5), ZCoordinate=0)
ln = Line(StartPoint=pt, EndPoint=pt_2)
sph = Sphere(Base=pt_2, Radius=Slider(5, range=0..10))
scx = SurfaceCurve(Surface=sph, Curve=ln)  # -> Curves, flatten(Points), UVPoints, Normals, Parameters, Tangents
tag_2 = TextTag3D(Location=scx.Points, Text=gh_cpython.tokens, Size=number_slider, Colour=gradient, Justification=7)
