# Grasshopper definition text_embeddings_v2.gh (Grasshopper 1.0.7)
# plug-ins: LunchBox

# ---- group: read csv
file = ReadFile(File="G:\My Drive\cell_latent_space.csv", PerLineParse=True)
csv = ReadCSV(CSVString=file, Delimiter=",")  # -> Headers, Values
panel = Panel(csv.Headers)
panel_2 = Panel(csv.Values)

# ---- group: structure data pipeline
bang = ExplodeTree(Data=panel_2)  # -> Branch0, Branch1, Branch2, Branch3
panel_3 = Panel(bang.Branch0)
panel_4 = Panel(bang.Branch1)
panel_5 = Panel(bang.Branch2)
panel_6 = Panel(bang.Branch3)

# ----
pt = ConstructPoint(XCoordinate=panel_3, YCoordinate=panel_4, ZCoordinate=panel_5)
bnd = Bounds(Numbers=pt)
remap = RemapNumbers(Value=pt, Source=bnd, Target=Domain(0, 1))  # -> Mapped, Clipped
gradient = Gradient(LowerLimit=0, UpperLimit=1, Parameter=remap.Mapped, stops=[0: RGB(0, 128, 0), 0.5: RGB(255, 255, 0), 1: RGB(255, 0, 0)])

# ---- group: map to a surface (optional)
pt_2 = ConstructPoint(XCoordinate=Slider(3, range=-5..5), YCoordinate=Slider(1, range=-5..5), ZCoordinate=0)
ln = Line(StartPoint=pt, EndPoint=pt_2)
sph = Sphere(Base=pt_2, Radius=Slider(21, range=0..100))
scx = SurfaceCurve(Surface=sph, Curve=ln)  # -> Curves, flatten(Points), UVPoints, Normals, Parameters, Tangents
tag = TextTag3D(Location=scx.Points, Text=panel_6, Size=Slider(0.162, range=0..1), Colour=gradient, Justification=7)

# ---- group: simple visualisation
tag_2 = TextTag(Location=pt, Text=panel_6, Colour=gradient)
cloud = CloudDisplay(Points=pt, Colours=gradient, Size=Slider(3.357, range=0..10), SpriteType=0)
